# Grasshopper definition multi_rack._base.gh (Grasshopper 1.0.8)

panel_width = Slider(18, range=0..100)
numer_of_modules = Slider(4, range=0..10)
vertical_divisions = Slider(6, range=0..10)
module_width = Slider(785, range=0..1000)
rack_depth = Slider(279, range=0..1000)
rack_height = Slider(1895, range=0..10000)
caps = BooleanToggle(False)
caps_2 = BooleanToggle(True)
find_assemblies = GhPythonScript()  # -> out
# ---------- find_assemblies: Python ----------
import Grasshopper as gh

this = ghenv.Component
thisDoc = this.OnPingDocument()

asms = []

for obj in thisDoc.Objects:
    #print obj.GetType().BaseType
    
    #if obj.Obsolete: print 'Warning: Obsolete'
    #print 'Name: {}\nDescription: {}\nCategory: {} -> {}\n '.format(obj.Name, obj.Description, obj.Category, obj.SubCategory)
    #print 'Pivot: {} \t Bounds: {}'.format(obj.Attributes.Pivot, obj.Attributes.Bounds)
    
    asm = gh.Instances.ComponentServer.FindAssemblyByObject(obj.ComponentGuid)
    
    #print(x.IsCoreLibrary)
    if asm is not None and not asm.IsCoreLibrary:
        asms.append(asm.Name)
    
print asms
# ---------- end find_assemblies ----------
module_width_2 = GetInteger(module_width, AtLeast=1, AtMost=1, Maximum=2147483647, Minimum=-2147483648, TreeAccess=False)
number_of_modules = GetInteger(numer_of_modules, AtLeast=1, AtMost=1, Maximum=2147483647, Minimum=-2147483648, TreeAccess=False)
rack_depth_2 = GetInteger(rack_depth, AtLeast=1, AtMost=1, Maximum=2147483647, Minimum=-2147483648, TreeAccess=False)
rack_height_2 = GetInteger(rack_height, AtLeast=1, AtMost=1, Maximum=2147483647, Minimum=-2147483648, TreeAccess=False)
vertical_divisions_2 = GetInteger(vertical_divisions, AtLeast=1, AtMost=1, Maximum=2147483647, Minimum=-2147483648, TreeAccess=False)
panel_thickness = GetInteger(panel_width, AtLeast=1, AtMost=1, Maximum=2147483647, Minimum=-2147483648, TreeAccess=False)
back_lid = GetBoolean(caps, AtLeast=1, AtMost=1, FalseValue="False", TreeAccess=False, TrueValue="True")
lids = GetBoolean(caps_2, AtLeast=1, AtMost=1, FalseValue="False", TreeAccess=False, TrueValue="True")
opening_height = GetInteger(Slider(85, range=0..100), AtLeast=1, AtMost=1, Maximum=2147483647, Minimum=-2147483648, TreeAccess=False)
opening_radius = GetInteger(Slider(20, range=0..100), AtLeast=1, AtMost=1, Maximum=2147483647, Minimum=-2147483648, TreeAccess=False)
panel = Panel(find_assemblies)
series = Series(Start="0", Step=module_width_2, Count=number_of_modules)
construct_point = ConstructPoint(XCoordinate=series, YCoordinate=0, ZCoordinate=0)
multiplication = Multiplication(A=lids, B="-1")
unit_z = UnitZ(Factor=rack_height_2)
move = Move(Geometry=construct_point, Motion=unit_z)  # -> Geometry, Transform
unit_y = UnitY(Factor=panel_thickness)
line = Line(StartPoint=construct_point, EndPoint=move.Geometry)
list_item = ListItem(List=line, Index="0", Wrap=True)
list_item_2 = ListItem(List=line, Index=multiplication, Wrap=True)
ruled_surface = RuledSurface(CurveA=list_item, CurveB=list_item_2)
divide_curve = DivideCurve(Curve=line, Count=vertical_divisions_2, Kinks=False)  # -> Points, Tangents, Parameters
flip_matrix = FlipMatrix(Data=divide_curve.Points)
extrude = Extrude(Base=ruled_surface, Direction=unit_y)
polyline = PolyLine(Vertices=flip_matrix, Closed=False)
unit_z_2 = UnitZ(Factor=opening_height)
unit_y_2 = UnitY(Factor=rack_depth_2)
move_2 = Move(Geometry=line, Motion=unit_y_2)  # -> Geometry, Transform
move_3 = Move(Geometry=polyline, Motion=unit_y_2)  # -> Geometry, Transform
move_4 = Move(Geometry=divide_curve.Points, Motion=unit_y_2)  # -> Geometry, Transform
multiplication_2 = Multiplication(A=back_lid, B="-1")
ruled_surface_2 = RuledSurface(CurveA=line, CurveB=move_2.Geometry)
list_item_3 = ListItem(List=flatten(polyline), Index="-1", Wrap=True)
list_item_4 = ListItem(List=flatten(move_3.Geometry), Index="-1", Wrap=True)
cull_index = CullIndex(List=flatten(move_3.Geometry), Indices="-1", Wrap=True)
cull_index_2 = CullIndex(List=flatten(polyline), Indices="-1", Wrap=True)
unit_y_3 = UnitY(Factor=panel_thickness)
division = Division(A=panel_thickness, B="2")
unit_x = UnitX(Factor=division)
division_2 = Division(A=panel_thickness, B="2")
unit_x_2 = UnitX(Factor=expr("-x", division_2))
list_item_5 = ListItem(List=move_2.Geometry, Index="0", Wrap=True)
list_item_6 = ListItem(List=move_2.Geometry, Index=multiplication_2, Wrap=True)
ruled_surface_3 = RuledSurface(CurveA=list_item_4, CurveB=list_item_3)
ruled_surface_4 = RuledSurface(CurveA=cull_index, CurveB=cull_index_2)
ruled_surface_5 = RuledSurface(CurveA=list_item_5, CurveB=list_item_6)
extrude_2 = Extrude(Base=ruled_surface_2, Direction=unit_x_2)
extrude_3 = Extrude(Base=ruled_surface_2, Direction=unit_x)
unit_y_4 = UnitY(Factor=panel_thickness)
unit_z_3 = UnitZ(Factor=panel_thickness)
extrude_4 = Extrude(Base=flatten(ruled_surface_4), Direction=unit_z_3)
extrude_5 = Extrude(Base=ruled_surface_5, Direction=unit_y_4)
extrude_6 = Extrude(Base=flatten(ruled_surface_3), Direction=expr("-x", unit_z_3))
cap_holes = CapHoles(Brep=extrude_4)
cap_holes_2 = CapHoles(Brep=extrude_6)
cap_holes_3 = CapHoles(Brep=[extrude_3, extrude_2])
merge = Merge(Data1=cap_holes_3, Data2=cap_holes, Data3=cap_holes_2)
solid_difference = SolidDifference(BrepsA=extrude, BrepsB=flatten(merge))
area = Area(Geometry=solid_difference)  # -> Area, Centroid
move_5 = Move(Geometry=area.Centroid, Motion=unit_z_2)  # -> Geometry, Transform
construct_plane = ConstructPlane(Origin=move_5.Geometry, XAxis=Vector(1, 0, 0), YAxis=line)
circle = Circle(Plane=construct_plane, Radius=opening_radius)
extrude_7 = Extrude(Base=circle, Direction=unit_y_3)
solid_difference_2 = SolidDifference(BrepsA=extrude_7, BrepsB=solid_difference)
merge_2 = Merge(Data1=merge, Data2=solid_difference_2, Data3=extrude_5)
geometry = Geometry(merge_2)
context_bake = ContextBake(Geometry=geometry)
