# Grasshopper definition multi_rack.gh (Grasshopper 1.0.8)
# plug-ins: Hops

hops = Hops(
    MODULE_WIDTH=Slider(600, range=0..1000),
    NUMBER_OF_MODULES=Slider(5, range=0..10),
    RACK_DEPTH=Slider(400, range=0..1000),
    RACK_HEIGHT=Slider(1000, range=0..10000),
    VERTICAL_DIVISIONS=Slider(3, range=0..10),
    PANEL_THICKNESS=Slider(20, range=0..100),
    BACK_LID=Toggle(True),
    LIDS=Toggle(True),
    OPENING_HEIGHT=Slider(0, range=0..50),
    OPENING_RADIUS=Slider(27, range=10..50),
    CacheResultsInMemory=True,
    CacheSolveResults=True,
    RemoteDefinitionLocation="C:\Users\joaqu\OneDrive\Escritorio\MACAD\TERM 2\S3 - DATA MGMT\multi_rack._base.gh",
    RemoteSolveVersion=(0, 1, 0),
    ShowInput_Enabled=False,
    ShowInput_Path=False,
    SynchronousSolve=True)
